# Dynamo custom node Export gbXML files.dyf (Dynamo 1.3.3.4111)
# category: BuildSimHub

folder = Input(folder: string)
filename = Input(filename: string)
rooms = Input(rooms: bool)
gbxml_export_setting = Python(IN[0]=folder, IN[1]=filename, IN[2]=rooms)
# ---------- gbxml_export_setting.python (84 lines) ----------
import clr
clr.AddReference('ProtoGeometry')
from Autodesk.DesignScript.Geometry import *
import clr

clr.AddReference("RevitServices")
import RevitServices
from RevitServices.Persistence import DocumentManager
from RevitServices.Transactions import TransactionManager
doc = DocumentManager.Instance.CurrentDBDocument

clr.AddReference("RevitAPI")
from Autodesk.Revit.DB import *



#The inputs to this node will be stored as a list in the IN variables.
folder = IN[0]
filename = IN[1]

oldmodel = Analysis.EnergyAnalysisDetailModel.GetMainEnergyAnalysisDetailModel(doc)

TransactionManager.Instance.EnsureInTransaction(doc)
try:
	doc.Delete(oldmodel.Id)
except:
	pass
TransactionManager.Instance.TransactionTaskDone()


rooms = ElementId(-2000160)
spaces = ElementId(-2003600)
"""energydata options"""
#all options for energydata can be found here: http://www.revitapidocs.com/2016/9108112c-330d-d570-f461-01bf62cb0d0f.htm
energydata = Analysis.EnergyDataSettings.GetFromDocument(doc)
TransactionManager.Instance.EnsureInTransaction(doc)
energydata.ExportComplexity = Analysis.gbXMLExportComplexity.ComplexWithMullionsAndShadingSurfaces
energydata.ExportDefaults = False
energydata.SliverSpaceTolerance = 5/304.8

if IN[2]:
	energydata.ExportCategory = rooms
else:
	energydata.ExportCategory = spaces

energydata.IncludeThermalProperties = True
TransactionManager.Instance.TransactionTaskDone()


"""EnergyAnalysisDetailModelOptions"""
optionsenergy = Analysis.EnergyAnalysisDetailModelOptions()
#Choose between detail (spaces or analytical surfaces) for export.
#ptionsenergy.Tier = Analysis.EnergyAnalysisDetailModelTier.FirstLevelBoundaries
optionsenergy.Tier = Analysis.EnergyAnalysisDetailModelTier.SecondLevelBoundaries
#optionsenergy.Tier = Analysis.EnergyAnalysisDetailModelTier.Final


#create EnergyAnalysisDetailModel
TransactionManager.Instance.EnsureInTransaction(doc)
model = Analysis.EnergyAnalysisDetailModel.Create(doc,optionsenergy)
TransactionManager.Instance.TransactionTaskDone()


#set export options to export for spaces/rooms or analytical model
options = GBXMLExportOptions()
options.ExportEnergyModelType = ExportEnergyModelType.SpatialElement


#export gbmxl
TransactionManager.Instance.EnsureInTransaction(doc)
try:
	doc.Export(folder,filename,options)
	result = True
except:
	result = False
TransactionManager.Instance.TransactionTaskDone()

import sys
sys.path.append(r'C:\Program Files (x86)\IronPython 2.7\Lib')
import os
file = filename + ".xml"
file_path = os.path.join(folder, file)
#Assign your output to the OUT variable.
OUT = file_path
# ----------------------------------------
filepath = Output(gbxml_export_setting)
