# Dynamo custom node Run simulation with API keys.dyf (Dynamo 1.3.3.4111)
# category: BuildSimHub

buildsimhub_api_path = Python()
# ---------- buildsimhub_api_path.python (15 lines) ----------
import clr
import sys
sys.path.append(r'C:\Program Files (x86)\IronPython 2.7\Lib')
import os

appdata_path = os.getenv('appdata')
dynamo_path = os.path.join(appdata_path, 'Dynamo')

module_path = None
for root, subfolders, files in os.walk(dynamo_path):
	if 'BuildSimHub' in subfolders:
		extra_path = os.path.join(root, 'BuildSimHub', 'extra')
		module_path = os.path.join(extra_path, 'buildsimhub_python_api')

OUT = module_path  or 'Could Not Find Module. Make sure it\'s installed properly'
# ----------------------------------------
RPW_GetFilepath = Custom[RPW_GetFilepath]()
project_api_key = Input(project_api_key: string)
model_api_key = Input(model_api_key: string)
buildsimhub_python_api = Python(IN[0]=buildsimhub_api_path, IN[1]=RPW_GetFilepath, IN[2]=project_api_key, IN[3]=model_api_key)
# ---------- buildsimhub_python_api.python (30 lines) ----------
import sys
# get into the buildsimhub_python_api foler
sys.path.append(IN[0])
# get into the RPW debug tool foler
sys.path.append(IN[1])


# import the debug tool console
from rpw.ui.forms import Console
# import BuildSimHubAPI libraries
import BuildSimHubAPI as bshapi


# assign api keys
project_api_key = IN[2]
model_api_key = IN[3]


# create a new simulation job and
bsh = bshapi.BuildSimHubAPIClient()
newsj = bsh.new_simulation_job(project_api_key)
model = newsj.run_model_simulation(track_token=model_api_key, track=True, unit='si')

results = bsh.model_results(project_api_key, model_api_key)
EUI = str(model.net_site_eui()) + " " + model.last_parameter_unit

# run the debug tool
#Console(context=locals())

OUT = EUI
# ----------------------------------------
