# Dynamo custom node Run simulation with files.dyf (Dynamo 1.3.3.4111)
# category: BuildSimHub
# idf, gbXML, epJSON

buildsimhub_api_path = Python()
# ---------- buildsimhub_api_path.python (15 lines) ----------
import clr
import sys
sys.path.append(r'C:\Program Files (x86)\IronPython 2.7\Lib')
import os

appdata_path = os.getenv('appdata')
dynamo_path = os.path.join(appdata_path, 'Dynamo')

module_path = None
for root, subfolders, files in os.walk(dynamo_path):
	if 'BuildSimHub' in subfolders:
		extra_path = os.path.join(root, 'BuildSimHub', 'extra')
		module_path = os.path.join(extra_path, 'buildsimhub_python_api')

OUT = module_path  or 'Could Not Find Module. Make sure it\'s installed properly'
# ----------------------------------------
project_API_key = Input(project_API_key: string)
filepath = Input(filepath: string)
rpw_console_path = Python()
# ---------- rpw_console_path.python (23 lines) ----------
""" 
RevitPythonWrapper
==================
Gui Talarico
https://github.com/gtalarico/revitpythonwrapper
http://revitpythonwrapper.readthedocs.io/en/latest/index.html
"""

import clr
import sys
sys.path.append(r'C:\Program Files (x86)\IronPython 2.7\Lib')
import os

appdata_path = os.getenv('appdata')
dynamo_path = os.path.join(appdata_path, 'Dynamo')

module_path = None
for root, subfolders, files in os.walk(dynamo_path):
	if 'RevitPythonWrapper' in subfolders:
		extra_path = os.path.join(root, 'BuildSimHub', 'extra')
		module_path = os.path.join(extra_path, 'rpw.zip')

OUT = module_path  or 'Could Not Find Module. Make sure it\'s installed properly'
# ----------------------------------------
buildsimhub_python_api = Python(IN[0]=buildsimhub_api_path, IN[1]=project_API_key, IN[2]=filepath, IN[3]=rpw_console_path)
# ---------- buildsimhub_python_api.python (30 lines) ----------
import sys
# get into the buildsimhub_python_api foler
sys.path.append(IN[0])
# get into the RPW debug tool foler
sys.path.append(IN[3])
# import the debug tool console
from rpw.ui.forms import Console



# import BuildSimHubAPI libraries
import BuildSimHubAPI as bshapi


# assign api keys
project_API_key = IN[1]
file_dir = IN[2]


# create a new simulation job and
bsh = bshapi.BuildSimHubAPIClient()
new_sj_run = bsh.new_simulation_job(project_API_key)

# run the debug tool
#Console(context=locals())

results = new_sj_run.run(file_dir, track=True)


OUT = "Simulation Done!"
# ----------------------------------------
Simulation_Report = Output(buildsimhub_python_api)
