# Dynamo graph demo_ export gbXML files.dyn (Dynamo 1.3.3.4111)

directory_path = Directory("C:\Users\sunar\Desktop")
string = StringInput("11111")
boolean = BoolSelector(true)
export_gbxml_files = Custom[Export gbXML files](folder=directory_path, filename=string, rooms=boolean)
