# Dynamo graph demo_run simulation with API keys.dyn (Dynamo 1.3.3.4111)

project_api_key = StringInput("")
model_api_key = StringInput("")
run_simulation_with_api_keys = Custom[Run Energy Simulation](project_api_key=project_api_key, model_api_key=model_api_key)
simulation_eui = Watch(run_simulation_with_api_keys)
