# Dynamo graph demo_run simulation with files.dyn (Dynamo 1.3.3.4111)

string = StringInput("a277363f-b20a-4603-9347-8d4e6365dfd8")
file_path = Filename("C:\Users\sunar\Desktop\11111.xml")
run_simulation_with_files = Custom[Run simulation with files](project_API_key=string, filepath=file_path)  # idf, gbXML, epJSON
