# Dynamo graph demo_run simulation with models.dyn (Dynamo 1.3.3.4111)

input_your_project_api_keys = StringInput("")
select_a_folder_for_gbxml_files = Directory("No file selected.")
give_names_to_gbxml_files = StringInput("")
rooms_as_volumes = BoolSelector(true)
export_gbxml_files = Custom[Export gbXML files](folder=select_a_folder_for_gbxml_files, filename=give_names_to_gbxml_files, rooms=rooms_as_volumes)
run_simulation_with_files = Custom[Run simulation with files](project_API_key=input_your_project_api_keys, filepath=export_gbxml_files)  # idf, gbXML, epJSON
simulation_report = Watch(run_simulation_with_files)
