# Dynamo graph test_run simulation with files.dyn (Dynamo 1.3.3.4111)

python_script = Python()
# ---------- python_script.python (15 lines) ----------
import clr
import sys
sys.path.append(r'C:\Program Files (x86)\IronPython 2.7\Lib')
import os

appdata_path = os.getenv('appdata')
dynamo_path = os.path.join(appdata_path, 'Dynamo')

module_path = None
for root, subfolders, files in os.walk(dynamo_path):
	if 'BuildSimHub' in subfolders:
		extra_path = os.path.join(root, 'BuildSimHub', 'extra')
		module_path = os.path.join(extra_path, 'buildsimhub_python_api')

OUT = module_path  or 'Could Not Find Module. Make sure it\'s installed properly'
# ----------------------------------------
RPW_GetFilepath = Custom[RPW_GetFilepath]()
project_api_key = StringInput("a277363f-b20a-4603-9347-8d4e6365dfd8")
file_path = Filename("..\11111.xml")
python_script_2 = Python(IN[0]=python_script, IN[1]=RPW_GetFilepath, IN[2]=project_api_key, IN[3]=file_path)
# ---------- python_script_2.python (29 lines) ----------
import sys
# get into the buildsimhub_python_api foler
sys.path.append(IN[0])
# get into the RPW debug tool foler
sys.path.append(IN[1])


# import the debug tool console
from rpw.ui.forms import Console
# import BuildSimHubAPI libraries
import BuildSimHubAPI as bshapi


# assign api keys
project_api_key = IN[2]
file_dir = IN[3]


# create a new simulation job and
bsh = bshapi.BuildSimHubAPIClient()
new_sj_run = bsh.new_simulation_job(project_api_key)
results = new_sj_run.run(file_dir, track=True)


OUT = "Simulation Done!"


# run the debug tool
#Console(context=locals())
# ----------------------------------------
simulation_process = Watch(python_script_2)
