# Dynamo graph test_run simulation with models.dyn (Dynamo 1.3.3.4111)

buildsimhub_python_api_path = Python()
# ---------- buildsimhub_python_api_path.python (15 lines) ----------
import clr
import sys
sys.path.append(r'C:\Program Files (x86)\IronPython 2.7\Lib')
import os

appdata_path = os.getenv('appdata')
dynamo_path = os.path.join(appdata_path, 'Dynamo')

module_path = None
for root, subfolders, files in os.walk(dynamo_path):
	if 'BuildSimHub' in subfolders:
		extra_path = os.path.join(root, 'BuildSimHub', 'extra')
		module_path = os.path.join(extra_path, 'buildsimhub_python_api')

OUT = module_path  or 'Could Not Find Module. Make sure it\'s installed properly'
# ----------------------------------------
rpw_console_path = Python()
# ---------- rpw_console_path.python (23 lines) ----------
""" 
RevitPythonWrapper
==================
Gui Talarico
https://github.com/gtalarico/revitpythonwrapper
http://revitpythonwrapper.readthedocs.io/en/latest/index.html
"""

import clr
import sys
sys.path.append(r'C:\Program Files (x86)\IronPython 2.7\Lib')
import os

appdata_path = os.getenv('appdata')
dynamo_path = os.path.join(appdata_path, 'Dynamo')

module_path = None
for root, subfolders, files in os.walk(dynamo_path):
	if 'RevitPythonWrapper' in subfolders:
		extra_path = os.path.join(root, 'BuildSimHub', 'extra')
		module_path = os.path.join(extra_path, 'rpw.zip')

OUT = module_path  or 'Could Not Find Module. Make sure it\'s installed properly'
# ----------------------------------------
project_api_key = StringInput("")
select_a_folder_for_the_gbxml = Directory("No file selected.")  # "Select a folder for the gbXML files"
give_a_name_to_the_gbxml_files = StringInput("")
rooms_as_volumes = BoolSelector(true)
export_gbxml = Python(IN[0]=select_a_folder_for_the_gbxml, IN[1]=give_a_name_to_the_gbxml_files, IN[2]=rooms_as_volumes)
# ---------- export_gbxml.python (84 lines) ----------
import clr
clr.AddReference('ProtoGeometry')
from Autodesk.DesignScript.Geometry import *
import clr

clr.AddReference("RevitServices")
import RevitServices
from RevitServices.Persistence import DocumentManager
from RevitServices.Transactions import TransactionManager
doc = DocumentManager.Instance.CurrentDBDocument

clr.AddReference("RevitAPI")
from Autodesk.Revit.DB import *



#The inputs to this node will be stored as a list in the IN variables.
folder = IN[0]
filename = IN[1]

oldmodel = Analysis.EnergyAnalysisDetailModel.GetMainEnergyAnalysisDetailModel(doc)

TransactionManager.Instance.EnsureInTransaction(doc)
try:
	doc.Delete(oldmodel.Id)
except:
	pass
TransactionManager.Instance.TransactionTaskDone()


rooms = ElementId(-2000160)
spaces = ElementId(-2003600)
"""energydata options"""
#all options for energydata can be found here: http://www.revitapidocs.com/2016/9108112c-330d-d570-f461-01bf62cb0d0f.htm
energydata = Analysis.EnergyDataSettings.GetFromDocument(doc)
TransactionManager.Instance.EnsureInTransaction(doc)
energydata.ExportComplexity = Analysis.gbXMLExportComplexity.ComplexWithMullionsAndShadingSurfaces
energydata.ExportDefaults = False
energydata.SliverSpaceTolerance = 5/304.8

if IN[2]:
	energydata.ExportCategory = rooms
else:
	energydata.ExportCategory = spaces

energydata.IncludeThermalProperties = True
TransactionManager.Instance.TransactionTaskDone()


"""EnergyAnalysisDetailModelOptions"""
optionsenergy = Analysis.EnergyAnalysisDetailModelOptions()
#Choose between detail (spaces or analytical surfaces) for export.
#ptionsenergy.Tier = Analysis.EnergyAnalysisDetailModelTier.FirstLevelBoundaries
optionsenergy.Tier = Analysis.EnergyAnalysisDetailModelTier.SecondLevelBoundaries
#optionsenergy.Tier = Analysis.EnergyAnalysisDetailModelTier.Final


#create EnergyAnalysisDetailModel
TransactionManager.Instance.EnsureInTransaction(doc)
model = Analysis.EnergyAnalysisDetailModel.Create(doc,optionsenergy)
TransactionManager.Instance.TransactionTaskDone()


#set export options to export for spaces/rooms or analytical model
options = GBXMLExportOptions()
options.ExportEnergyModelType = ExportEnergyModelType.SpatialElement


#export gbmxl
TransactionManager.Instance.EnsureInTransaction(doc)
try:
	doc.Export(folder,filename,options)
	result = True
except:
	result = False
TransactionManager.Instance.TransactionTaskDone()

import sys
sys.path.append(r'C:\Program Files (x86)\IronPython 2.7\Lib')
import os
file = filename + ".xml"
file_path = os.path.join(folder, file)
#Assign your output to the OUT variable.
OUT = file_path
# ----------------------------------------
run_simulation_with_files = Python(IN[0]=buildsimhub_python_api_path, IN[1]=rpw_console_path, IN[2]=project_api_key, IN[3]=export_gbxml)
# ---------- run_simulation_with_files.python (31 lines) ----------
import sys
# get into the buildsimhub_python_api foler
sys.path.append(IN[0])


# get into the RPW debug tool foler
sys.path.append(IN[1])
# import the debug tool console
from rpw.ui.forms import Console


# import BuildSimHubAPI libraries
import BuildSimHubAPI as bshapi

# assign api keys
project_API_key = IN[2]
file_dir = IN[3]


# create a new simulation job and
bsh = bshapi.BuildSimHubAPIClient()
new_sj_run = bsh.new_simulation_job(project_API_key)

#Console(context=locals())

results = new_sj_run.run(file_dir, track=True)

OUT = "Simulation is Done!"


# run the debug tool
# ----------------------------------------
simulation_process = Watch(run_simulation_with_files)
